# Dynamo graph PlaceMultipleRevitCustomNodes.dyn (Dynamo 2.0.0.3726)

byOrigin = CoordinateSystem.ByOrigin()
code_block = CodeBlock { 20; 20; }
levels = Levels(index=0)
wall_types = WallTypes(index=10)
rectangularWalls = Custom[RectangularWalls](cs=byOrigin, width=code_block.out0, length=code_block.out1, level=levels, wallType=wall_types)  # Makes some walls
code_block_2 = CodeBlock { 70; 100; }
byOrigin_2 = CoordinateSystem.ByOrigin(x=code_block_2.out0, y=code_block_2.out0)
rectangularWalls_2 = Custom[RectangularWalls](cs=byOrigin_2, width=code_block_2.out0, length=code_block_2.out1, level=levels, wallType=wall_types)
