# Dynamo graph CreateFamilyTypeByGeometry.dyn (Dynamo 1.2.1.2802)

byCoordinates = Point.ByCoordinates()
code_block = CodeBlock { 100; }
byCoordinates_2 = Point.ByCoordinates(x=code_block, y=code_block, z=code_block)
byCorners = Cuboid.ByCorners(lowPoint=byCoordinates, highPoint=byCoordinates_2)
code_block_2 = CodeBlock { "MyFamilyType"; }
categories = Categories("Mass")
code_block_3 = CodeBlock { "C:\ProgramData\Autodesk\RVT 2016\Family Templates\English\Metric Generic Model.rft"; }
code_block_4 = CodeBlock { "Poche"; }
byName = Material.ByName(code_block_4)
byGeometry = FamilyType.ByGeometry(byCorners, code_block_2, categories, code_block_3, byName)
