# Dynamo graph DuplicateSheet.dyn (Dynamo 2.6.1.9130)

sheets = Sheets("Title Sheet")
boolean = BoolSelector(true)
string = StringInput("Test")
duplicateSheet = Sheet.DuplicateSheet(sheet=sheets, DuplicateWithView=boolean, prefix=string)
views = Sheet.Views(sheet=duplicateSheet)
