# Dynamo graph WallByFace.dyn (Dynamo 1.2.1.2802)

wall_location = WallLocation("CoreCenterline")
wall_types = WallTypes("Generic - 5\"")
select_face = DSFaceSelection()  # 1 picked in the model
byFace = Wall.ByFace(wall_location, wall_types, select_face)
